# Grasshopper definition Find AOC.gh (Grasshopper 1.0.8)
# plug-ins: CORE.Toolbox.Grasshopper

# ----
# Paste from MS-Excel
displacement_mm = Panel("A2:A7")
force_kn = Panel("B2:B7")

find_aoc = BooleanToggle(True)
file_path = Panel("C:\Users\Tufail Mabood\Desktop\Find AOC\Example FD Curve.xlsx")
sheet_name_if_not_matching_it_will_creat = Panel("Sheet1")  # "Sheet Name (If not matching, it will create new sheet)"
displacement = ReadFromExcel(
    WorkbookFilepath=file_path,
    WorksheetName=sheet_name_if_not_matching_it_will_creat,
    Range=displacement_mm,
    Live=False,
    Stream=find_aoc)  # -> flatten(Data)
force = ReadFromExcel(
    WorkbookFilepath=file_path,
    WorksheetName=sheet_name_if_not_matching_it_will_creat,
    Range=force_kn,
    Live=False,
    Stream=find_aoc)  # -> flatten(Data)
e_kn_mm = EKNMm(X=displacement, Y=force, L=displacement, L_2=force)  # -> pt_3, A
exp_slab_model_fd_curve = QuickGraph(e_kn_mm.pt_3, SortOrder=0)
work_done_kn_mm = Panel(e_kn_mm.A)
visualize_in_rhino_viewport = VisualizeInRhinoViewport(points=e_kn_mm.pt_3)

# ==== cluster EKNMm
L = ClusterInput()
L_2 = ClusterInput()
item = ListItem(List=L, Index=-1, Wrap=True)
item_2 = ListItem(List=L_2, Index=0, Wrap=True)
X = ClusterInput()
Y = ClusterInput()
pt = ConstructPoint(XCoordinate=X, YCoordinate=Y, ZCoordinate=0)
pt_2 = ConstructPoint(XCoordinate=item, YCoordinate=item_2, ZCoordinate=0)
pt_3 = ClusterOutput(pt)
pline = PolyLine(Vertices=[pt, pt_2], Closed=True)
area = Area(Geometry=pline)  # -> Area, Centroid
A = ClusterOutput(area.Area)

# ==== cluster VisualizeInRhinoViewport
points = ClusterInput()
visualize_in_rhino_viewport = PolyLine(Vertices=points, Closed=False)
pl = ClusterOutput(visualize_in_rhino_viewport)
