# Grasshopper definition Hyst-to-Backbone.gh (Grasshopper 1.0.8)

# ----
# Backbone Curve (Exp/Num)
displacement_mm = Panel("""0
0.007874631
0.015741497
0.023592647
0.035318926
0.052758515
0.078393646
0.115094177
0.164402544
0.220059931
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""")
force_kn = Panel("""0.772301257
0.886418641
1.007148147
1.127735138
1.307846308
1.575723052
1.969547272
2.533461094
3.291346073
4.147461414
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""")
pt = ConstructPoint(XCoordinate=displacement_mm, YCoordinate=force_kn, ZCoordinate=0)  # -> flatten(Point)
pline = PolyLine(Vertices=pt, Closed=False)

# ----
# Internalize and Process Points
pt_2 = Point([Point(-125.5096054, -44.55643082, 0), Point(-122.4245987, -45.32190323, 0), Point(-118.8090668, -45.66102219, 0), Point(-115.4139481, -45.80152512, 0), Point(-111.6155853, -46.20055389, 0), Point(-110.0893097, -46.84178925, 0)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])
pline_2 = PolyLine(Vertices=pt_2, Closed=False)
divide = DivideCurve(Curve=pline_2, Count=Slider(10000, range=100..10000), Kinks=False)  # -> Points, Tangents, Parameters
pdecon = Deconstruct(Point=divide.Points)  # -> XComponent, YComponent, ZComponent
for_excel_displacement = Panel(pdecon.XComponent)
for_excel_force = Panel(pdecon.YComponent)

# ----
# Split Backbone Curve
larger = LargerThan(FirstNumber=for_excel_displacement, SecondNumber=0)  # -> LargerThan, OrEqualTo
larger_2 = LargerThan(FirstNumber=for_excel_force, SecondNumber=0)  # -> LargerThan, OrEqualTo
smaller = SmallerThan(FirstNumber=pdecon.XComponent, SecondNumber=0)  # -> SmallerThan, OrEqualTo
smaller_2 = SmallerThan(FirstNumber=pdecon.YComponent, SecondNumber=0)  # -> SmallerThan, OrEqualTo
and = GateAnd(A=larger.OrEqualTo, B=larger_2.OrEqualTo)
and_2 = GateAnd(A=smaller.OrEqualTo, B=smaller_2.OrEqualTo)
cull = CullPattern(List=divide.Points, CullPattern=and)
cull_2 = CullPattern(List=divide.Points, CullPattern=and_2)
pdecon_2 = Deconstruct(Point=cull)  # -> XComponent, YComponent, ZComponent
pdecon_3 = Deconstruct(Point=cull_2)  # -> XComponent, YComponent, ZComponent
expression = Expression(x=pdecon_3.XComponent, Expression="-X")
expression_2 = Expression(x=pdecon_3.YComponent, Expression="-X")
for_excel_u_ve = Panel(pdecon_2.XComponent)
for_excel_f_ve = Panel(pdecon_2.YComponent)
for_excel_u_ve_2 = Panel(expression)
for_excel_f_ve_2 = Panel(expression_2)

# ----
# Energy Absorption-Pull
neg = Negative(Value=for_excel_u_ve_2)
item = ListItem(List=neg, Index=0, Wrap=True)
pt_3 = ConstructPoint(XCoordinate=item, YCoordinate=0, ZCoordinate=0)
pline_3 = PolyLine(Vertices=[cull_2, pt_3], Closed=True)
boundary = BoundarySurfaces(Edges=pline_3)
area = Area(Geometry=boundary)  # -> Area, Centroid
energy_absorbed_in_pull = Panel(area.Area)

# ----
# Energy Absorption-Push
item_2 = ListItem(List=for_excel_u_ve, Index=-1, Wrap=True)
pt_4 = ConstructPoint(XCoordinate=item_2, YCoordinate=0, ZCoordinate=0)
pline_4 = PolyLine(Vertices=[cull, pt_4], Closed=True)
boundary_2 = BoundarySurfaces(Edges=pline_4)
area_2 = Area(Geometry=boundary_2)  # -> Area, Centroid
energy_absorbed_in_push = Panel(area_2.Area)
