# Grasshopper definition Pt to txt.ghx (Grasshopper 1.0.7)

# Github.com/tufailmab
write_path_to_file_with_file_name_and_ex = Panel("F:\Pt to txt\Exported Points.txt")  # "Write Path to File with File Name and Extension"
export_points = BooleanToggle(True)
pt = Point([Point(-251.3314158, -389.2560228, -32.98932013), Point(356.4648134, 273.7039969, -411.1530999), Point(-403.9955027, 451.6898365, -17.41205133), Point(361.1707454, 445.1836482, 472.0496992), Point(368.3155635, -487.3142443, 463.9904331), Point(-397.9353075, 10.08270891, -484.9754767)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])
pt_to_txt_file = GhPythonScript(points=pt, path=write_path_to_file_with_file_name_and_ex, write=export_points)  # inputs points: list of Point3d
# ---------- pt_to_txt_file: Python ----------
import Rhino.Geometry as rg

credit_line = 'Developed by "Tufail Mabood" MSc Structure\ngithub: github.com/tufailmab\n\n'

if write and points and path:
    try:
        with open(path, 'w') as f:
            f.write(credit_line)
            
            count = 0
            for item in points:
                pt = None
                
                if hasattr(item, 'X') and hasattr(item, 'Y') and hasattr(item, 'Z'):
                    pt = item
                
                elif isinstance(item, str):
                    clean = item.strip().strip('()')
                    coords = clean.split(',')
                    if len(coords) == 3:
                        try:
                            x, y, z = float(coords[0]), float(coords[1]), float(coords[2])
                            pt = rg.Point3d(x, y, z)
                        except:
                            pass
                
                if pt is None and isinstance(item, str):
                    coords = item.split(',')
                    if len(coords) == 3:
                        try:
                            x, y, z = float(coords[0]), float(coords[1]), float(coords[2])
                            pt = rg.Point3d(x, y, z)
                        except:
                            pass
                
                if pt is not None:
                    f.write("{:.6f},{:.6f},{:.6f}\n".format(pt.X, pt.Y, pt.Z))
                    count += 1
        
        print("SUCCESS: Exported {} points with credit header to:\n{}".format(count, path))
    
    except Exception as e:
        print("Error writing file:")
        print(str(e))

else:
    if not write:
        print("Flip 'write' to True to export.")
    if not points:
        print("No points provided.")
    if not path:
        print("Please provide a valid file path.")
# ---------- end pt_to_txt_file ----------
